# Grasshopper definition Getting_Started.gh (Grasshopper 1.0.8)
# plug-ins: Ariadne

# ----
# Forward form finding
number_slider = Slider(1, range=1..100)  # disabled
dummy = DummyNetwork()  # disabled
number_slider_2 = Slider(1, range=1..100)  # disabled
neg = Negative(Value=number_slider)  # disabled
Z = UnitZ(Factor=neg)  # disabled
theseus = TheseusSolve(Network=dummy, ForceDensities=number_slider_2, Loads=Z)  # -> Network, Nodes, Edges, ForceDensities, MemberForces, MemberLengths, Iterations, Converged; disabled

# ----
# The OptConfig is the core of your control over the optimization hyperparameters.
# 
# qMin - Minimum force density for an edge (one value or repeat to match edge list length)
# 
# qMax - Maximum force density for an edge
# 
# MaxIter - Maximum number of optimization iterations.
# 
# AbsTol - Absolute objective stopping value (i.e. if objective value goes below 1.0, stop the optimization)
# 
# RelTol - Relative objective stopping value (i.e. if the change in the objective value between iterations is below this value, stop the optimization)
# 
# BW - Barrier Weight, controls the influence of the barrier penalty on the q values. If you find your optimization is often trying to find solutions where a bunch of edges want to flip signs (into compression or tension) then you should try increasing this value.
# 
# BS - Barrier Sharpness, controls the steepness of the barrier penalty. You can usually leave this alone. Increase if you want the barriers to be more like a wall, decrease if you want to allow for more violation of the limits.
# 
# ReportFreq - If 'Stream' is set to true then this controls how often an update is visualized.
# 
# Run - Set to true if you would like to run the optimization. Use a button to run the optimization once. Use a toggle to set in 'open loop' mode where any upstream change will interrupt an ongoing optimization and start a fresh one with your edited inputs.
# 
# Stream - Live stream updates during the optimization. Defaults to true. If you want to run an optimization and only see the final result, set this to false.
optconfig = OptimizationConfig(
    LowerBounds=0.1,
    UpperBounds=100,
    MaxIterations=500,
    AbsoluteTolerance=1e-06,
    RelativeTolerance=1e-06,
    BarrierWeight=10,
    BarrierSharpness=10,
    ReportFrequency=10,
    Run=False,
    StreamPreview=True)

# ----
# This boolean toggle runs the optimization in 'open loop' mode and will re-optimize if anything changes up stream. Swap with a button for incremental control.
toggle = BooleanToggle(True)

# ----
# Optimizing towards a target geometry
dummy_2 = DummyNetwork()
neg_2 = Negative(Value=Slider(1.708, range=1..100))
Z_2 = UnitZ(Factor=neg_2)

# ----
# Objectives can be assigned to a subset of network components. Swap a single node for all nodes (or remove the input to nodes to implicitly apply the objective to all nodes in the network).
deconstruct_network = DeconstructFDMNetwork(FDMNetwork=dummy_2)  # -> Nodes, Edges, EdgeIndices, AdjacencyList, FreeNodeIndices, FreeNodes, FixedNodeIndices, FixedNodes
item = ListItem(List=deconstruct_network.FreeNodes, Index=0, Wrap=True)
targetxy = TargetGeometryXY(Nodes=item, Weight=1)

optconfig_2 = OptimizationConfig(
    Objectives=targetxy,
    LowerBounds=0.1,
    UpperBounds=100,
    MaxIterations=500,
    AbsoluteTolerance=1e-06,
    RelativeTolerance=1e-06,
    BarrierWeight=10,
    BarrierSharpness=10,
    ReportFrequency=10,
    Run=toggle,
    StreamPreview=True)
theseus_2 = TheseusSolve(Network=dummy_2, ForceDensities=Slider(12.881, range=1..100), Loads=Z_2, OptConfig=optconfig_2)  # -> Network, Nodes, Edges, ForceDensities, MemberForces, MemberLengths, Iterations, Converged
